% Simulink data dictionary constants.sldd

astro_constants = Simulink.Parameter(struct(
  pi2=6.283185,
  Rad=0.01745329,
  Deg=57.29578,
  Arcs=206264.8,
  MJD_J2000=51544.5,
  T_B1950=-0.500002108,
  c_light=299792458,
  AU=149597870700,
  R_Earth=6378137,
  f_Earth=0.003352811,
  R_Sun=696000000,
  R_Moon=1738000,
  omega_Earth=7.292115e-05,
  GM_Earth=398600441500000,
  GM_Sun=1.327124e+20,
  GM_Moon=4.9028e+12,
  GM_Mercury=22031868551000,
  GM_Venus=324858592000000,
  GM_Mars=42828375816000,
  GM_Jupiter=1.267127641e+17,
  GM_Saturn=3.79405848418e+16,
  GM_Uranus=5.7945564e+15,
  GM_Neptune=6.83652710058e+15,
  GM_Pluto=975500000000,
  P_Sol=4.559821e-06,
  DPI=3.141593,
  D2PI=6.283185,
  DR2D=57.29578,
  DD2R=0.01745329,
  DR2AS=206264.8,
  DAS2R=4.848137e-06,
  DS2R=7.272205e-05,
  TURNAS=1296000,
  DMAS2R=4.848137e-09,
  DTY=365.242198781,
  DAYSEC=86400,
  DJY=365.25,
  DJC=36525,
  DJM=365250,
  DJ00=2451545,
  DJM0=2400000.5,
  DJM00=51544.5,
  DJM77=43144,
  TTMTAI=32.184,
  DAU=149597870700,
  CMPS=299792458,
  AULT=499.0048,
  DC=173.1446,
  ELG=6.969290134e-10,
  ELB=1.550519768e-8,
  TDB0=-6.55e-5,
  SRS=1.97412574336e-8))

eopdata = Simulink.Parameter([1962 1962 1962 1962 1962 1962 1962 1962 1962 1962 1962 1962 1962 1962 1962 1962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
 1 1 1 1 1 1 1 1 1 1 1 1 1 1 1 1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
 1 2 3 4 5 6 7 8 9 10 11 12 13 14 15 16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
 37665 37666 37667 37668 37669 37670 37671 37672 37673 37674 37675 37676 37677 37678 37679 37680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
 -0.0127 -0.0159 -0.019 -0.021999 -0.024799 -0.027599 -0.030199 -0.032798 -0.035198 -0.037498 -0.039697 -0.041797 -0.043797 -0.045697 -0.047496 -0.049196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
 0.213 0.2141 0.2152 0.216301 0.217301 0.218301 0.219301 0.220202 0.221102 0.222002 0.222803 0.223703 0.224503 0.225203 0.226004 0.226704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
 0.0326338 0.0320547 0.0315526 0.0311435 0.0308154 0.0305353 0.0302682 0.029928 0.0294869 0.0289268 0.0282797 0.0276136 0.0270075 0.0265403 0.0262572 0.0261751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
 0.001723 0.001669 0.001582 0.001496 0.001416 0.001382 0.001413 0.001505 0.001628 0.001738 0.001794 0.001774 0.001667 0.00151 0.001312 0.001112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
 0.064261 0.063979 0.06387 0.063893 0.06388 0.063826 0.063921 0.064251 0.064647 0.064867 0.064837 0.064662 0.064474 0.064323 0.064183 0.064061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
 0.006067 0.00629 0.006515 0.006574 0.006374 0.006045 0.005872 0.006018 0.006351 0.006594 0.006619 0.006498 0.006342 0.006182 0.006028 0.005926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
 0 0 0 0 0 0 0 0 0 0 0 0 0 0 0 0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
 0 0 0 0 0 0 0 0 0 0 0 0 0 0 0 0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
 2 2 2 2 2 2 2 2 2 2 2 2 2 2 2 2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 ])